# Grasshopper definition StraightSkeleton.gh (Grasshopper 1.0.7)
# plug-ins: Pufferfish

crv = Curve([<curve referenced from the Rhino model> x8])
crv_2 = Curve(<curve referenced from the Rhino model>)
crveditpts = CurveEditPoints(Curve=crv, Knots=True)  # -> Points, Tangents, Parameters
crveditpts_2 = CurveEditPoints(Curve=crv_2, Knots=True)  # -> Points, Tangents, Parameters
split = SplitList(List=crveditpts.Points, Index=1)  # -> ListA, ListB
split_2 = SplitList(List=crveditpts_2.Points, Index=1)  # -> ListA, ListB

lng = ListLength(List=split_2.ListB)
random = Random(Range="0 to 0.0001", Number=lng, Seed=1)
random_2 = Random(Range="0 to 0.0001", Number=lng, Seed=2)
pt = ConstructPoint(XCoordinate=random, YCoordinate=random_2, ZCoordinate=0)
move = Move(Geometry=split_2.ListB, Motion=pt)  # -> Geometry, Transform

lng_2 = ListLength(List=split.ListB)
random_3 = Random(Range="0 to 0.0001", Number=lng_2, Seed=1)
random_4 = Random(Range="0 to 0.0001", Number=lng_2, Seed=2)
pt_2 = ConstructPoint(XCoordinate=random_3, YCoordinate=random_4, ZCoordinate=0)
move_2 = Move(Geometry=split.ListB, Motion=pt_2)  # -> Geometry, Transform

pline = PolyLine(Vertices=move.Geometry, Closed=True)
pline_2 = PolyLine(Vertices=move_2.Geometry, Closed=True)  # -> flatten(Polyline)
c_script = CSharpScript(outer_boundary=pline, holes=pline_2)  # -> out, A; inputs outer_boundary: Polyline, holes: list of Polyline
# ---------- c_script: C# ----------
    var Points = outer_boundary;
    string holeCount = holes.Count.ToString();
    string holestring = "";
    foreach(var hole in holes)
    {
      holestring += PolylineToString(hole);
    }


    A = PolylineToString(Points) + holeCount + "\n" + holestring;
# ---------- c_script: C# additional code ----------
  private String PolylineToString(Polyline inputPolyline)
  {
    var Points = inputPolyline;

    Points.RemoveAt(0);
    string res = "";
    foreach(Point3d pt in Points)
    {
      res += pt.X.ToString() + " " + pt.Y.ToString() + "\n";
    }
    string vertexNum = Points.Count.ToString();
    return vertexNum + "\n" + res;
  }
# ---------- end c_script ----------
panel = Panel(c_script.A)
