# Grasshopper definition StraightSkeletonTest.gh (Grasshopper 1.0.7)

divdist = DivideDistance(Curve=<geometry referenced from the Rhino model>, Distance=Slider(10, range=0..10))  # -> Points, Tangents, Parameters
lng = ListLength(List=divdist.Points)
random = Random(Range=Domain(0, 1), Number=lng, Seed=2)
multiplication = Multiplication(A=Slider(100, range=0..100), B=random)
amp = Amplitude(Vector=unitize(divdist.Points), Amplitude=multiplication)
move = Move(Geometry=divdist.Points, Motion=amp)  # -> Geometry, Transform
pline = PolyLine(Vertices=move.Geometry, Closed=True)
