# Grasshopper definition StraightSkeletonTest2.gh (Grasshopper 1.0.7)

crv = Curve(<curve referenced from the Rhino model>)
pop2d = Populate2D(Region=crv, Count=400, Seed=1)
geo = Geometry([<curve referenced from the Rhino model> x100])
area = Area(Geometry=geo)  # -> Area, Centroid
lng = ListLength(List=geo)
random = Random(Range=Domain(0, 3.141592654), Number=lng, Seed=2)
rotate = Rotate(Geometry=geo, Angle=random, Plane=area.Centroid)  # -> Geometry, Transform
voronoi = Voronoi(Points=pop2d, Radius=Slider(3.46, range=0..10), BruteForceOverride=True)
