# Grasshopper definition test.gh (Grasshopper 1.0.7)
# plug-ins: Super Delaunay 2d

geo = Geometry(<brep referenced from the Rhino model>)
pop3d = Populate3D(Region=geo, Count=100, Seed=1)
pop2d = Populate2D(
    Region={Plane=PlaneXY(0, 0, 0), Size=Domain2(u=0..20, v=0..10)},
    Count=Slider(1000, range=0..1000),
    Seed=Slider(2, range=0..10))
delaunay = Delaunay(
    Points=pop3d,
    DelaunayInputMode=0,
    DelaunayOutputMode=1,
    DelaunayPreview_Edges=False,
    DelaunayPreview_Edges_Color=RGB(18, 76, 184),
    DelaunayPreview_InfiniteTriangles=False,
    DelaunayPreview_Orthoballs_Color=RGB(222, 60, 60),
    DelaunayPreview_Points=False,
    DelaunayPreview_Points_Color=RGB(201, 54, 54),
    DelaunayPreview_Weights=True,
    DelaunayPreview_Weights_Color=RGB(194, 136, 29))  # -> Delaunay, Edges, EdgesTopology, Connected
